# Grasshopper definition frame.gh (Grasshopper 0.9.80)

width = Slider(136, range=130..140)
z = Slider(4.472, range=3..7)
temple_height = Slider(7.058, range=0..10)
side_thickness = Slider(7.203, range=5.75..7.5)
bottom_temple = Slider(129.908, range=0..200)
nosepiece_x = Slider(1.36, range=0..1.5)
nosepiece_thickenss = Slider(1.698, range=1..5)
x_y_thickness = Slider(2.501, range=2..3)
top_temple = Slider(-4, range=-50..100)
bridge_thickness = Slider(3.611, range=3..5.5)
nosepiece_angle = Slider(-0.151, range=-1..1)
pd = Slider(66, range=65..70)
bridge_height = Slider(6.368, range=0..7)
nosepiece_height = Slider(9, range=4..15)
temple_xz_angle = Slider(6.094, range=0..10)
bottom_bridge = Slider(73.217, range=0..100)
hinge_inner_radius = Slider(2.38, range=0..10)
temple_xy_angle = Slider(6.45, range=0..10)
hinge_height = Slider(7.172, range=0..10)
top_bridge = Slider(51.02, range=0..100)
lens = Geometry(<curve referenced from the Rhino model>)

# ---- group: inner frame
connect = ConnectCurves(Curves=lens, Continuity=2, Close=True, Bulge=1)
closed_lens = Geometry(connect)
area = Area(Geometry=closed_lens)  # -> Area, Centroid
centerpoint = Point(area.Centroid)
pdecon = Deconstruct(Point=centerpoint)  # -> XComponent, YComponent, ZComponent
number = Number(-1)
number_2 = Number(-1)
multiplication = Multiplication(A=pdecon.YComponent, B=number)
multiplication_2 = Multiplication(A=number_2, B=pdecon.XComponent)
X = UnitX(Factor=multiplication_2)
Y = UnitY(Factor=multiplication)
move = Move(Geometry=lens, Motion=X)  # -> Geometry, Transform
move_2 = Move(Geometry=move.Geometry, Motion=Y)  # -> Geometry, Transform
inner_lens = Geometry(move_2.Geometry)

# ---- group: center line
_0_0_0 = Point(Point(0, 0, 0))
Y_2 = UnitY(Factor=bridge_thickness)
move_3 = Move(Geometry=_0_0_0, Motion=Y_2)  # -> Geometry, Transform
bottom_center_bridge = Point(_0_0_0)
top_center_bridge = Point(move_3.Geometry)
Y_3 = UnitY(Factor=bridge_height)
move_4 = Move(Geometry=bottom_center_bridge, Motion=Y_3)  # -> Geometry, Transform
move_5 = Move(Geometry=top_center_bridge, Motion=Y_3)  # -> Geometry, Transform
ln = Line(StartPoint=move_4.Geometry, EndPoint=move_5.Geometry)
center_line = Geometry(ln)

# ---- group: side
division = Division(A=width, B=2)
Y_4 = UnitY(Factor=temple_height)
division_2 = Division(A=width, B=2)
_0 = Number(0)
_0_2 = Number(0)
_0_3 = Number(0)
pt = ConstructPoint(XCoordinate=division, YCoordinate=side_thickness, ZCoordinate=_0)
pt_2 = ConstructPoint(XCoordinate=division_2, YCoordinate=_0_2, ZCoordinate=_0_3)
move_6 = Move(Geometry=pt, Motion=Y_4)  # -> Geometry, Transform
move_7 = Move(Geometry=pt_2, Motion=Y_4)  # -> Geometry, Transform
top_right_point = Point(move_6.Geometry)
bottom_right_point = Point(move_7.Geometry)
ln_2 = Line(StartPoint=move_6.Geometry, EndPoint=move_7.Geometry)
side = Geometry(ln_2)

# ---- group: move PD
_2 = Number(2)
division_3 = Division(A=pd, B=_2)
X_2 = UnitX(Factor=division_3)
move_8 = Move(Geometry=inner_lens, Motion=X_2)  # -> Geometry, Transform

# ---- group: outer frame
offset = Offset(Curve=move_8.Geometry, Distance=x_y_thickness, Plane=PlaneXY(0, 0, 0), Corners=1)
outer_frame = Geometry(flatten(offset))

# ---- group: temple
side_2 = Geometry(side)
end = EndPoints(Curve=side_2)  # -> Start, End
top_point = Point(end.Start)
bottom_point = Point(end.End)
X_3 = UnitX(Factor=-1)
move_9 = Move(Geometry=top_point, Motion=X_3)  # -> Geometry, Transform
X_4 = UnitX(Factor=-1)
move_10 = Move(Geometry=bottom_point, Motion=X_4)  # -> Geometry, Transform
eval = EvaluateCurve(Curve=outer_frame, Parameter=top_temple)  # -> Point, Tangent, Angle
addition = Addition(A=top_temple, B=1)
eval_2 = EvaluateCurve(Curve=outer_frame, Parameter=addition)  # -> Point, Tangent, Angle
eval_3 = EvaluateCurve(Curve=outer_frame, Parameter=bottom_temple)  # -> Point, Tangent, Angle
addition_2 = Addition(A=bottom_temple, B=1)
eval_4 = EvaluateCurve(Curve=outer_frame, Parameter=addition_2)  # -> Point, Tangent, Angle
intcrv = Interpolate(Vertices=[top_point, move_9.Geometry, eval.Point, eval_2.Point], Degree=3, Periodic=False, KnotStyle=1)  # -> Curve, Length, Domain
ln_3 = Line(StartPoint=eval_2.Point, EndPoint=eval_3.Point)
intcrv_2 = Interpolate(Vertices=[eval_3.Point, eval_4.Point, move_10.Geometry, bottom_point], Degree=3, Periodic=False, KnotStyle=1)  # -> Curve, Length, Domain
join = JoinCurves(Curves=[side_2, ln_3, intcrv.Curve, intcrv_2.Curve], Preserve=False)

# ---- group: bridge
center_line_2 = Line(center_line)
end_2 = EndPoints(Curve=center_line_2)  # -> Start, End
bottom_point_2 = Point(end_2.Start)
top_point_2 = Point(end_2.End)
X_5 = UnitX(Factor=0.1)
move_11 = Move(Geometry=top_point_2, Motion=X_5)  # -> Geometry, Transform
X_6 = UnitX(Factor=0.01)
move_12 = Move(Geometry=bottom_point_2, Motion=X_6)  # -> Geometry, Transform
eval_5 = EvaluateCurve(Curve=outer_frame, Parameter=top_bridge)  # -> Point, Tangent, Angle
eval_6 = EvaluateCurve(Curve=outer_frame, Parameter=bottom_bridge)  # -> Point, Tangent, Angle
addition_3 = Addition(A=top_bridge, B=1)
eval_7 = EvaluateCurve(Curve=outer_frame, Parameter=addition_3)  # -> Point, Tangent, Angle
addition_4 = Addition(A=bottom_bridge, B=1)
eval_8 = EvaluateCurve(Curve=outer_frame, Parameter=addition_4)  # -> Point, Tangent, Angle
intcrv_3 = Interpolate(Vertices=[eval_8.Point, eval_6.Point, move_12.Geometry, bottom_point_2], Degree=3, Periodic=False, KnotStyle=1)  # -> Curve, Length, Domain
intcrv_4 = Interpolate(Vertices=[eval_5.Point, eval_7.Point, move_11.Geometry, top_point_2], Degree=3, Periodic=False, KnotStyle=1)  # -> Curve, Length, Domain

# ----
ln_4 = Line(StartPoint=eval_8.Point, EndPoint=eval_5.Point)

# ---- group: bridge (continued)
join_2 = JoinCurves(Curves=[center_line_2, intcrv_3.Curve, intcrv_4.Curve, ln_4], Preserve=False)

# ---- group: frame surface
outer_frame_2 = Geometry(outer_frame)
temple = Geometry(join)
brige = Geometry(join_2)
inner_frame = Geometry(move_8.Geometry)
runion = RegionUnion(Curves=flatten([outer_frame_2, brige, temple]))
boundary = BoundarySurfaces(Edges=inner_frame)
boundary_2 = BoundarySurfaces(Edges=runion)
sdiff = SolidDifference(BrepsA=boundary_2, BrepsB=boundary)
frame = Geometry(reverse(sdiff))

# ---- group: frame
frame_surface = Surface(flatten(frame))
Z = UnitZ(Factor=z)
extr = Extrude(Base=frame_surface, Direction=Z)
frame_2 = Geometry(extr)

# ---- group: hinges
side_temple = Geometry(side)
len = Length(Curve=side_temple)
multiplication_3 = Multiplication(A=len, B=-1)
X_7 = UnitX(Factor=multiplication_3)
move_13 = Move(Geometry=side_temple, Motion=X_7)  # -> Geometry, Transform
end_3 = EndPoints(Curve=move_13.Geometry)  # -> Start, End
end_4 = EndPoints(Curve=side_temple)  # -> Start, End
pt_3 = Point(end_3.Start)
pt_4 = Point(end_4.End)
box = Box2Pt(PointA=pt_3, PointB=pt_4, Plane=PlaneXY(0, 0, 0))
area_2 = Area(Geometry=box)  # -> Area, Centroid
circle = CircleCNR(Center=area_2.Centroid, Normal=Vector(0, 0, 1), Radius=hinge_inner_radius)
square = Geometry(box)
Z_2 = UnitZ(Factor=1)
move_14 = Move(Geometry=square, Motion=Z_2)  # -> Geometry, Transform
bbox = BoundingBox(Content=circle, Plane=PlaneXY(0, 0, 0))  # -> Box, Box_2
Z_3 = UnitZ(Factor=hinge_height)
extr_2 = Extrude(Base=move_14.Geometry, Direction=Z_3)
Z_4 = UnitZ(Factor=1.5)
move_15 = Move(Geometry=bbox.Box, Motion=Z_4)  # -> Geometry, Transform
outer_cube = Geometry(extr_2)
Z_5 = UnitZ(Factor=20)
extr_3 = Extrude(Base=move_15.Geometry, Direction=Z_5)
inner_cube = Geometry(extr_3)
area_3 = Area(Geometry=outer_cube)  # -> Area, Centroid
yz = YZPlane(Origin=area_3.Centroid)
rotate = Rotate(Geometry=outer_cube, Angle=temple_xy_angle, Plane=yz)  # -> Geometry, Transform
outer_cube_xy = Geometry(rotate.Geometry)
area_4 = Area(Geometry=outer_cube)  # -> Area, Centroid
xz = XZPlane(Origin=area_4.Centroid)
rotate_2 = Rotate(Geometry=outer_cube_xy, Angle=temple_xz_angle, Plane=xz)  # -> Geometry, Transform
area_5 = Area(Geometry=outer_cube)  # -> Area, Centroid
yz_2 = YZPlane(Origin=area_5.Centroid)
rotate_3 = Rotate(Geometry=inner_cube, Angle=temple_xy_angle, Plane=yz_2)  # -> Geometry, Transform
inner_cyliner_xy = Geometry(rotate_3.Geometry)
area_6 = Area(Geometry=outer_cube)  # -> Area, Centroid
xz_2 = XZPlane(Origin=area_6.Centroid)
rotate_4 = Rotate(Geometry=inner_cyliner_xy, Angle=temple_xz_angle, Plane=xz_2)  # -> Geometry, Transform
frame_3 = Geometry(frame_2)
inner_cube_2 = Geometry(rotate_4.Geometry)
outer_cube_2 = Geometry(rotate_2.Geometry)
sdiff_2 = SolidDifference(BrepsA=outer_cube_2, BrepsB=inner_cube_2)

# ----
sdiff_3 = SolidDifference(BrepsA=frame_3, BrepsB=inner_cube_2)

# ---- group: hinges (continued)
right_frame_with_hinge = Geometry([sdiff_2, sdiff_3])

# ---- group: nosepiece
frame_4 = Geometry(runion)
explode = Explode(Curve=frame_4, Recursive=True)  # -> Segments, Vertices
pt_5 = Point(<point referenced from the Rhino model>)
crv_cp = CurveClosestPoint(Point=pt_5, Curve=explode.Segments)  # -> Point, Parameter, Distance
sort = SortList(Keys=crv_cp.Distance, ValuesA=explode.Segments)  # -> Keys, ValuesA
item = ListItem(List=sort.ValuesA, Index=0, Wrap=True)
crv = Curve(item)
curvepoint = PointOnCurve(crv, parameter=0.2)
curvepoint_2 = PointOnCurve(crv, parameter=0.599)
curvepoint_3 = PointOnCurve(crv, parameter=1)
intcrv_5 = Interpolate(Vertices=[curvepoint, curvepoint_2, curvepoint_3], Degree=3, Periodic=False, KnotStyle=1)  # -> Curve, Length, Domain
Z_6 = UnitZ(Factor=nosepiece_height)
extr_4 = Extrude(Base=intcrv_5.Curve, Direction=Z_6)
X_8 = UnitX(Factor=nosepiece_thickenss)
Z_7 = UnitZ(Factor=Slider(3.28, range=1..5))
X_9 = UnitX(Factor=nosepiece_x)

# ---- group: nosepiece curve
end_5 = EndPoints(Curve=intcrv_5.Curve)  # -> Start, End
curvepoint_4 = PointOnCurve(crv, parameter=0.653)
Z_8 = UnitZ(Factor=Slider(2, range=0..10))
move_16 = Move(Geometry=curvepoint_4, Motion=Z_8)  # -> Geometry, Transform
intcrv_6 = Interpolate(Vertices=[end_5.Start, move_16.Geometry, end_5.End], Degree=3, Periodic=False, KnotStyle=1)  # -> Curve, Length, Domain
number_slider = Slider(10, range=0..10)
X_10 = UnitX(Factor=number_slider)
extr_5 = Extrude(Base=intcrv_6.Curve, Direction=X_10)
Z_9 = UnitZ(Factor=number_slider)
extr_6 = Extrude(Base=extr_5, Direction=Z_9)
Z_10 = UnitZ(Factor=nosepiece_height)
move_17 = Move(Geometry=extr_6, Motion=Z_10)  # -> Geometry, Transform

# ----
extr_7 = Extrude(Base=extr_4, Direction=X_8)

# ---- group: nosepiece (continued)
move_18 = Move(Geometry=extr_7, Motion=Z_7)  # -> Geometry, Transform
area_7 = Area(Geometry=move_18.Geometry)  # -> Area, Centroid
xz_3 = XZPlane(Origin=area_7.Centroid)
rotate_5 = Rotate(Geometry=move_18.Geometry, Angle=nosepiece_angle, Plane=xz_3)  # -> Geometry, Transform
sdiff_4 = SolidDifference(BrepsA=rotate_5.Geometry, BrepsB=move_17.Geometry)
move_19 = Move(Geometry=sdiff_4, Motion=X_9)  # -> Geometry, Transform

# ----
right_nosepiece = Geometry(move_19.Geometry)
right_frame = Geometry(right_frame_with_hinge)
sunion = SolidUnion(Breps=[right_frame, right_nosepiece])
mirror = Mirror(Geometry=sunion, Plane=PlaneYZ(0, 0, 0))  # -> Geometry, Transform
left_frame = Geometry(mirror.Geometry)
right_frame_2 = Geometry(sunion)
full_frame = Geometry([right_frame_2, left_frame])

bake_me = Geometry(flatten(full_frame))
